# Grasshopper definition exo coloring3.gh (Grasshopper 0.9.76)
# plug-ins: MarchingCubes, Python Interpreter, Anemone, Weaverbird, Kangaroo2 Components

size = Slider(100, range=0..100)  # disabled

# ---- group: Settings / World
size_2 = Slider(40, range=0..100)  # disabled
box = DomainBox(Base=PlaneXY(0, 0, 0), X=size_2, Y=size_2, Z=size)  # disabled
wires = BrepWireframe(Brep=box, Density=-1)  # disabled

# ---- group: Settings
number = Slider(249, range=0..300)  # disabled
pop3d = Populate3D(Region=box, Count=number, Seed=1)  # disabled

# ---- group: Settings / Random vectors
number_slider = Slider(292, range=0..1000)  # disabled
number_slider_2 = Slider(456, range=0..1000)  # disabled
number_slider_3 = Slider(789, range=0..1000)  # disabled
panel = Panel("-1 to 1")  # disabled
random = Random(Range=panel, Number=number, Seed=number_slider)  # disabled
random_2 = Random(Range=panel, Number=number, Seed=number_slider_2)  # disabled
random_3 = Random(Range=panel, Number=number, Seed=number_slider_3)  # disabled
vec = VectorXYZ(XComponent=random, YComponent=random_2, ZComponent=random_3)  # -> Vector, Length; disabled

# ----
cohesion = Slider(4.2389, range=0..5)  # disabled
number_slider_4 = Slider(0, range=0..10)  # disabled
number_slider_5 = Slider(24.144, range=0..50)  # disabled
separation = Slider(1.4937, range=0..2)  # disabled
alignment = Slider(1.6305, range=0..4)  # disabled
number_slider_6 = Slider(1.038, range=0..10)  # disabled
number_slider_7 = Slider(4.036, range=0..10)  # disabled

# ---- group: Settings
repeats = Slider(145, range=0..1000)  # disabled
separation_2 = ConstructDomain(DomainStart=number_slider_4, DomainEnd=number_slider_6)  # disabled
alignment_2 = ConstructDomain(DomainStart=number_slider_6, DomainEnd=number_slider_7)  # disabled
cohesion_2 = ConstructDomain(DomainStart=number_slider_7, DomainEnd=number_slider_5)  # disabled

# ----
loop_start = LoopStart(
    Repeat=repeats,
    Trigger=[separation, alignment, cohesion, number_slider_4, number_slider_6, number_slider_7, number_slider_5],
    Data_0=pop3d,
    Data_1=vec.Vector)  # -> port, Counter, Data_0, Data_1; disabled
int = Integer(8)  # disabled
prox = Proximity3D(Points=loop_start.Data_0, Group=int, MinRadius=number_slider_4, MaxRadius=number_slider_5)  # -> Links, Topology; disabled
len = Length(Curve=prox.Links)  # disabled
inc = Includes(Value=len, Domain=separation_2)  # -> Includes, Deviation; disabled
inc_2 = Includes(Value=len, Domain=alignment_2)  # -> Includes, Deviation; disabled
inc_3 = Includes(Value=len, Domain=cohesion_2)  # -> Includes, Deviation; disabled
cull = CullPattern(List=prox.Topology, CullPattern=inc.Includes)  # disabled
cull_2 = CullPattern(List=prox.Topology, CullPattern=inc_3.Includes)  # disabled
cull_3 = CullPattern(List=prox.Topology, CullPattern=inc_2.Includes)  # disabled
item = ListItem(List=loop_start.Data_0, Index=cull, Wrap=False)  # disabled
item_2 = ListItem(List=loop_start.Data_1, Index=cull_3, Wrap=False)  # disabled
item_3 = ListItem(List=loop_start.Data_0, Index=cull_2, Wrap=False)  # disabled
avr = Average(Input=item)  # -> flatten(ArithmeticMean); disabled
avr_2 = Average(Input=item_3)  # -> flatten(ArithmeticMean); disabled
vec2pt = Vector2Pt(PointA=avr, PointB=loop_start.Data_0, Unitize=False)  # -> Vector, Length; disabled
vec2pt_2 = Vector2Pt(PointA=loop_start.Data_0, PointB=avr_2, Unitize=True)  # -> Vector, Length; disabled
null = NullItem(Item=vec2pt.Vector)  # -> NullFlags, InvalidFlags, Description; disabled
null_2 = NullItem(Item=vec2pt_2.Vector)  # -> NullFlags, InvalidFlags, Description; disabled
ma = MassAddition(Input=null.NullFlags)  # -> Result, PartialResults; disabled
ma_2 = MassAddition(Input=null_2.NullFlags)  # -> Result, PartialResults; disabled
vec_0_0_0 = Vector(Vector(0, 0, 0))  # disabled
lng = ListLength(List=ma.Result)  # disabled
lng_2 = ListLength(List=ma_2.Result)  # disabled
dup = DuplicateData(Data=vec_0_0_0, Number=lng, Order=True)  # disabled
dup_2 = DuplicateData(Data=vec_0_0_0, Number=lng_2, Order=True)  # disabled
nullrep = ReplaceNulls(Items=vec2pt.Vector, Replacements=dup)  # -> Items, Count; disabled
nullrep_2 = ReplaceNulls(Items=vec2pt_2.Vector, Replacements=dup_2)  # -> Items, Count; disabled
vlen = VectorLength(Vector=nullrep.Items)  # disabled
vlen_2 = VectorLength(Vector=nullrep_2.Items)  # disabled
expression = Expression(x=vlen, Expression="if(x=0,1000,x)")  # disabled
avr_3 = Average(Input=item_2)  # -> simplify(graft(ArithmeticMean)); disabled
expression_2 = Expression(x=vlen_2, Expression="if(x=0,1000,x)")  # disabled
unit = UnitVector(Vector=avr_3)  # disabled
one_over_x = OneOverX(Value=expression)  # disabled
multiplication = Multiplication(A=nullrep_2.Items, B=expression_2)  # disabled
multiplication_2 = Multiplication(A=nullrep.Items, B=one_over_x)  # disabled
multiplication_3 = Multiplication(A=multiplication_2, B=separation)  # -> simplify(graft(Result)); disabled
multiplication_4 = Multiplication(A=unit, B=alignment)  # -> simplify(graft(Result)); disabled
multiplication_5 = Multiplication(A=multiplication, B=cohesion)  # -> simplify(graft(Result)); disabled
merge = Merge(Data1=multiplication_3, Data2=multiplication_4, Data3=multiplication_5)  # disabled
avr_4 = Average(Input=merge)  # -> flatten(ArithmeticMean); disabled
move = Move(Geometry=loop_start.Data_0, Motion=avr_4)  # -> Geometry, Transform; disabled
pdecon = Deconstruct(Point=move.Geometry)  # -> XComponent, YComponent, ZComponent; disabled
num = Number(0)  # disabled
num_2 = Number(size_2)  # disabled
num_3 = Number(0)  # disabled
num_4 = Number(size)  # disabled
num_5 = Number(size_2)  # disabled
num_6 = Number(0)  # disabled
expression_3 = Expression(x=pdecon.YComponent, y=num_3, z=num_5, Expression="if(x<0,z,if(x>z,0,x))")  # disabled
expression_4 = Expression(x=pdecon.ZComponent, y=num_6, z=num_4, Expression="if(x<0,z,if(x>z,0,x))")  # disabled
expression_5 = Expression(x=pdecon.XComponent, y=num, z=num_2, Expression="if(x<0,z,if(x>z,0,x))")  # disabled
pt = ConstructPoint(XCoordinate=expression_5, YCoordinate=expression_3, ZCoordinate=expression_4)  # disabled
unit_2 = UnitVector(Vector=avr_4)  # disabled
loop_end = LoopEnd(port=loop_start.port, Exit=False, Data_0=flatten(pt), Data_1=flatten(avr_4), pausedState=False, state="Constant output")  # -> Data_0, Data_1; disabled
vdisex = VectorDisplayEx(Point=pt, Vector=unit_2, Colour=RGB(0, 0, 0), Width=2)  # disabled

number_slider_8 = Slider(14.917, range=0..30)  # disabled
number_slider_9 = Slider(0.604, range=0..1)  # disabled
number_slider_10 = Slider(8.917, range=0..10)  # disabled
number_slider_11 = Slider(1, range=0..1)  # disabled
number_slider_12 = Slider(0.063, range=0..1)  # disabled
toggle = BooleanToggle(True)  # disabled
python = PythonScript(x=pt)  # -> out, a; inputs x: list; disabled
# ---------- python: Python ----------
import rhinoscriptsyntax as rs
a = []
x0 = x.pop()
while x:
    x1 = rs.PointArrayClosestPoint(x, x0)
    x1_p = x.pop(x1)
    a.append(rs.AddLine(x0, x1_p))
    x0 = x1_p
# ---------- end python ----------
curve_charge = CurveCharge(Curve=python.a, Radius=number_slider_10, ChargeStrengths=number_slider_9)  # disabled
point_charge = PointCharge(Point=pt, Radius=number_slider_8, ChargeStrength=number_slider_9)  # disabled
merge_2 = Merge(Data1=curve_charge, Data2=point_charge)  # disabled
mesh = Mesh([<mesh referenced from the Rhino model> x5])
cocoon = Cocoon(Charges=merge_2, Iso=number_slider_12, CellSize=number_slider_11, Execute=toggle, Simple=False)  # -> Mesh, RefinementData; disabled
pt_2 = Point(Point(1000, 1000, 0))
pt_3 = Point(Point(-1000, -90, 0))
munion = MeshUnion(Meshes=flatten(mesh))
rec_2pt = Rectangle2Pt(Plane=PlaneXY(0, 0, 0), PointA=pt_3, PointB=pt_2, Radius=0)  # -> Rectangle, Length
weld = WeldMesh(Mesh=munion, Angle=Slider(23.321, range=0..90))
boxrec = BoxRectangle(Rectangle=rec_2pt.Rectangle, Height=Slider(-39, range=-100..0))
c_script = CSharpScript(M=weld, P="99.5")  # -> out, A; inputs M: Mesh, P: Double
# ---------- c_script: C# ----------
    if(M != null){
      Guid meshObj = doc.Objects.AddMesh(M);
      doc.Objects.UnselectAll();
      doc.Objects.Select(meshObj);
      Rhino.RhinoApp.RunScript("_-ReduceMesh _ReductionPercentage " + Convert.ToString(P) + " _Enter", false);
      Rhino.DocObjects.RhinoObject MObj = doc.Objects.GetSelectedObjects(false, false).First();
      doc.Objects.Delete(meshObj, true);
      A = MObj.Geometry;
    }
# ---------- end c_script ----------
mbox = MeshBox(Base=boxrec, XCount=10, YCount=10, ZCount=10)
mdif = MeshDifference(MeshesA=c_script.A, MeshesB=mbox)
weight = Slider(0.018, range=0..1)
medges = MeshEdges(Mesh=mdif)  # -> NakedEdges, InteriorEdges, NonManifoldEdges
neg = Negative(Value=weight)
len_2 = Length(Curve=medges.InteriorEdges)
python_2 = PythonScript(x=medges.InteriorEdges)  # -> out, a; inputs x: list
# ---------- python_2: Python ----------
import math
# a = [26000000 * math.pi * .3 * .3 /2 for j in range(0, len(x))]
a = [1000000 for j in range(0, len(x))]
# ---------- end python_2 ----------
end = EndPoints(Curve=graft(medges.InteriorEdges))  # -> Start, End
Z = UnitZ(Factor=neg)
demesh = DeconstructMesh(Mesh=mdif)  # -> Vertices, Faces, Colours, Normals
multiplication_6 = Multiplication(A=len_2, B=Z)
length_line = LengthLine(Line=medges.InteriorEdges, Strength=python_2.a)
panel_2 = Panel(python_2.a)
python_3 = PythonScript(x=demesh.Vertices)  # -> out, a; inputs x: list of Point3d
# ---------- python_3: Python ----------
a = []
for pnt in x:
    if pnt[2] < 0.001:
        a.append(pnt)
# ---------- end python_3 ----------
load = Load(Point=[end.Start, end.End], ForceVector=multiplication_6)
anchor = Anchor(Point=python_3.a, Strength="30000")
solver = Solver(
    GoalObjects=flatten([length_line, load, anchor]),
    Reset=Toggle(False),
    Restart=False,
    Parallel=True,
    Threshold=1e-15,
    Tolerance=0.01,
    AddCurrent=False,
    On=Toggle(False))  # -> V, O
python_4 = PythonScript(new_lengths=solver.O, original_lines=medges.InteriorEdges)  # -> out, a, b, e, stressed_edges, num_triangulations; inputs new_lengths: list, original_lines: list
# ---------- python_4: Python ----------
import rhinoscriptsyntax as rs
import math
a = []
b = []
e = []
num_triangulations = 0
max_dt = 0
stressed_edges = []
j = 0
for i in range(0, len(new_lengths)):
    if new_lengths[i] and rs.IsLine(new_lengths[i]):
        ol = rs.CurveLength(original_lines[j])
        if rs.CurveLength(new_lengths[i]) > 4:
            dt = abs(ol - rs.CurveLength(new_lengths[i]))
            max_dt = max(max_dt, dt)
            if(dt > .02):
                stressed_edges.append(original_lines[j])
            b.append(dt)
            c = 1 + dt
            k = c / ol + .25
            a.append(k)
            e.append(original_lines[j])
            num_triangulations = math.log(max_dt * 9, 3)
        else:
            b.append(0)
        j += 1
    # if i and rs.IsLine(i) and rs.CurveLength(i) > 1:
        # a.append(i)
# ---------- end python_4 ----------
wbweave = WeaverbirdsMeshFromLinesWeaveBack(Lines=python_4.e, MaximumValence=4)
neg_2 = Negative(Value=".01")
demesh_2 = DeconstructMesh(Mesh=wbweave)  # -> Vertices, Faces, Colours, Normals
gradient = Gradient(
    LowerLimit=neg_2,
    UpperLimit=".01",
    Parameter=python_4.b,
    stops=[0: RGB(255, 0, 0), 0.295: RGB(255, 255, 0), 0.501: RGB(0, 255, 0), 0.705: RGB(255, 255, 0), 1: RGB(220, 0, 40)])
end_2 = EndPoints(Curve=python_4.stressed_edges)  # -> Start, End
line = Line(python_4.stressed_edges)
python_5 = PythonScript(x=end_2.Start, e=end_2.End, y=demesh_2.Faces, z=demesh_2.Vertices)  # -> out, a; inputs x: list, e: list, y: list, z: list
# ---------- python_5: Python ----------
import rhinoscriptsyntax as rs
a = []
for i in range(0, len(x)):
    for face in y:
        face_v = [z[face.A], z[face.B], z[face.C], z[face.D]]
        for elt in face_v:
            if rs.Distance(x[i], elt) < 0.1:
                for dlt in face_v:
                    if rs.Distance(e[i], dlt) < 0.1:
                        a.append(face)
# ---------- end python_5 ----------
colour = ColourPicker(PickedColour=RGB(8, 96, 255))
conmesh = ConstructMesh(Vertices=demesh_2.Vertices, Faces=python_5.a)
wbtriangles = WeaverbirdsSplitTrianglesSubdivision(MeshCurves=conmesh, Level=python_4.num_triangulations)
pipe = Pipe(Curve=python_4.e, Radius=python_4.a, Caps=0)  # disabled
wbsplitquads = WeaverbirdsConstantQuadsSplitSubdivision(MeshCurves=conmesh, Level=1, SmoothNakedEdges=1)
preview = CustomPreview(Geometry=medges.InteriorEdges, Shader=gradient)
medges_2 = MeshEdges(Mesh=wbtriangles)  # -> NakedEdges, InteriorEdges, NonManifoldEdges
preview_2 = CustomPreview(Geometry=line, Shader=colour)
medges_3 = MeshEdges(Mesh=wbsplitquads)  # -> NakedEdges, InteriorEdges, NonManifoldEdges
wbweave_2 = WeaverbirdsMeshFromLinesWeaveBack(Lines=[medges_2.InteriorEdges, medges_2.NakedEdges, medges.InteriorEdges], MaximumValence=4)
weld_2 = WeldMesh(Mesh=flatten(pipe), Angle=3.141592654)  # disabled
medges_4 = MeshEdges(Mesh=wbweave_2)  # -> NakedEdges, InteriorEdges, NonManifoldEdges
colour_2 = ColourPicker(PickedColour=RGB(197, 117, 0))
pipe_2 = Pipe(Curve=[medges_4.NakedEdges, medges_4.InteriorEdges, medges_4.NonManifoldEdges], Radius=".3", Caps=0)
wbfacepolys = WeaverbirdsFacePolylines(Mesh=flatten(wbweave_2))
preview_3 = CustomPreview(Geometry=[medges_2.NakedEdges, medges_2.InteriorEdges], Shader=colour_2)
weld_3 = WeldMesh(Mesh=flatten(pipe_2), Angle=3.141592654)
boundary = BoundarySurfaces(Edges=wbfacepolys)
python_6 = PythonScript(x=flatten([medges_4.NakedEdges, medges_4.InteriorEdges, medges_4.NonManifoldEdges]))  # -> out, a; inputs x: list
# ---------- python_6: Python ----------
import rhinoscriptsyntax as rs
import math
a = sum([rs.CurveLength(i) for i in x])
a = a * .3*.3 * math.pi * 7850 * 0.00110231 * 1699
# ---------- end python_6 ----------
panel_3 = Panel(python_6.a)
